# Grasshopper definition SpikyThing.gh (Grasshopper 1.0.7)
# plug-ins: Python, MeshStreamer
# Spherical spikey thing

# ---- group: ctrl
radius = Slider(3.65, range=0..10)
count = Slider(33, range=1..100)
length = Slider(6.26, range=0..10)
density = Slider(1, range=1..3)

# ----
radius_2 = GetNumber(radius, AtLeast=1, AtMost=2147483647, Maximum=1.797693135e+308, Minimum=-1.797693135e+308, TreeAccess=False)
count_2 = GetInteger(count, AtLeast=1, AtMost=1, Maximum=2147483647, Minimum=-2147483648, TreeAccess=False)
length_2 = GetNumber(length, AtLeast=1, AtMost=2147483647, Maximum=1.797693135e+308, Minimum=-1.797693135e+308, TreeAccess=False)
density_2 = GetInteger(density, AtLeast=1, AtMost=1, Maximum=2147483647, Minimum=-2147483648, TreeAccess=False)
pt = ConstructPoint(XCoordinate=0, YCoordinate=0, ZCoordinate=0)
msphere = MeshSphere(Base=pt, Radius=radius_2, UCount=10, VCount=20)
popgeo = PopulateGeometry(Geometry=msphere, Count=count_2, Seed=1)
facet = FacetDome(Points=popgeo, Radius=radius_2)  # -> Pattern, Dome
explode = Explode(Curve=facet.Pattern, Recursive=True)  # -> Segments, Vertices
curvepoint = PointOnCurve(explode.Segments, parameter=0.5)
avr = Average(Input=curvepoint)
lng = ListLength(List=explode.Segments)
vec2pt = Vector2Pt(PointA=pt, PointB=avr, Unitize=invert(False))  # -> Vector, Length
amp = Amplitude(Vector=vec2pt.Vector, Amplitude=length_2)
addition = Addition(A=avr, B=amp)
end = EndPoints(Curve=graft(explode.Segments))  # -> Start, End
dup = DuplicateData(Data=addition, Number=lng, Order=True)
pshift = ShiftPaths(Data=dup, Offset=-1)  # -> graft(Data)
merge = Merge(Data1=end.Start, Data2=end.End, Data3=pshift)
triangle = MeshTriangle(CornerA=0, CornerB=1, CornerC=2)
conmesh = ConstructMesh(Vertices=merge, Faces=triangle)
mjoin = MeshJoin(Meshes=flatten(conmesh))
alignvert = AlignVertices(Mesh=mjoin, Tolerance=0.1)  # -> Result, Count
weld = WeldMesh(Mesh=alignvert.Result, Angle=3.141592654)
subdmesh = SubDFromMesh(Mesh=weld, Creases=1, Corners=1, Interpolate=False)
meshsubd = MeshFromSubD(SubD=subdmesh, Density=density_2)
demesh = DeconstructMesh(Mesh=meshsubd)  # -> Vertices, Faces, Colours, Normals
randcolors = RandomColors(Count=demesh.Vertices)
mspray = MeshSpray(Mesh=meshsubd, Points=demesh.Vertices, Colours=randcolors, SprayMode=1)
# enable if you want use direct mode
toggle = BooleanToggle(False)
meshuistream = MeshUIStreamer(Meshes=mspray, Groups="ctrl", Port=8081, Enable=toggle)  # -> Status, Clients, DataSize

# ---- group: RH_OUT:mesh
# used with rhinocompute mode
mesh = Mesh(mspray)

# ----
panel = Panel([meshuistream.Status, meshuistream.Clients, meshuistream.DataSize])
